# Grasshopper definition Workshop (1).gh (Grasshopper 0.9.76)
# plug-ins: Weaverbird, Tarsier, TT Toolbox

boolean_toggle = BooleanToggle(True)

# ---- group: Temperature
boolean_toggle_2 = BooleanToggle(True)
read_excel_sheet = ReadExcelSheet(Run=boolean_toggle, Worksheet="Sheet2", Listen=False)  # -> UserMessages, Columns, Rows

# ---- group: Precipitation / ReadExcelData
boolean_toggle_3 = BooleanToggle(True)
read_excel_sheet_2 = ReadExcelSheet(Run=boolean_toggle, Worksheet="Sheet3", Listen=False)  # -> UserMessages, Columns, Rows

# ---- group: Ice / ReadExcelData
boolean_toggle_4 = BooleanToggle(True)
read_excel_sheet_3 = ReadExcelSheet(Run=boolean_toggle, Worksheet="Sheet4", Listen=False)  # -> UserMessages, Columns, Rows

# ---- group: Wind / ReadExcel
boolean_toggle_5 = BooleanToggle(True)
read_excel_sheet_4 = ReadExcelSheet(Run=boolean_toggle, Worksheet="Sheet1", Listen=False)  # -> UserMessages, Columns, Rows

# ---- group: Temperature / TemperatureLatitude
list_item = ListItem(List=read_excel_sheet.Rows, Index=Slider(0, range=0..100), Wrap=True)  # -> flatten(Item)
cull_index = CullIndex(List=list_item, Indices=Slider(0, range=0..100), Wrap=True)
radians = Radians(Degrees=cull_index)

# ---- group: Temperature / TemperatureLongitude
list_item_2 = ListItem(List=read_excel_sheet.Rows, Index=Slider(1, range=0..100), Wrap=True)  # -> flatten(Item)
cull_index_2 = CullIndex(List=list_item_2, Indices=Slider(0, range=0..100), Wrap=True)
radians_2 = Radians(Degrees=cull_index_2)

# ---- group: Temperature
list_item_3 = ListItem(List=read_excel_sheet.Rows, Index=Slider(2, range=0..100), Wrap=True)  # -> flatten(Item)
cull_index_3 = CullIndex(List=list_item_3, Indices=Slider(0, range=0..100), Wrap=True)
c_script = CSharpScript(x=flatten(cull_index_3))  # -> out, A; inputs x: String
# ---------- c_script: C# ----------
    string ou = x;

    if( ou == "" ) ou = "1";

    double inte = System.Convert.ToDouble(ou);

    A = ou;
# ---------- end c_script ----------
bounds = Bounds(Numbers=c_script.A)
construct_domain = ConstructDomain(DomainStart=0, DomainEnd=Slider(255, range=0..1000))
remap_numbers = RemapNumbers(Value=c_script.A, Source=bounds, Target=construct_domain)  # -> Mapped, Clipped

# ---- group: Precipitation / PrecipitationLongitude
list_item_4 = ListItem(List=read_excel_sheet_2.Rows, Index=Slider(1, range=0..100), Wrap=True)  # -> flatten(Item)
cull_index_4 = CullIndex(List=list_item_4, Indices=Slider(0, range=0..100), Wrap=True)
radians_3 = Radians(Degrees=cull_index_4)

# ---- group: Precipitation / PrecipitationLatitude
list_item_5 = ListItem(List=read_excel_sheet_2.Rows, Index=Slider(0, range=0..100), Wrap=True)  # -> flatten(Item)
cull_index_5 = CullIndex(List=list_item_5, Indices=Slider(0, range=0..100), Wrap=True)
radians_4 = Radians(Degrees=cull_index_5)

# ---- group: Ice / IceLatitude
list_item_6 = ListItem(List=read_excel_sheet_3.Rows, Index=Slider(0, range=0..100), Wrap=True)  # -> flatten(Item)
cull_index_6 = CullIndex(List=list_item_6, Indices=Slider(0, range=0..100), Wrap=True)
radians_5 = Radians(Degrees=cull_index_6)

# ---- group: Ice / IceLongitude
list_item_7 = ListItem(List=read_excel_sheet_3.Rows, Index=Slider(1, range=0..100), Wrap=True)  # -> flatten(Item)
cull_index_7 = CullIndex(List=list_item_7, Indices=Slider(0, range=0..100), Wrap=True)
radians_6 = Radians(Degrees=cull_index_7)

# ---- group: Precipitation
list_item_8 = ListItem(List=read_excel_sheet_2.Rows, Index=Slider(2, range=0..100), Wrap=True)  # -> flatten(Item)
cull_index_8 = CullIndex(List=list_item_8, Indices=Slider(0, range=0..100), Wrap=True)
c_script_2 = CSharpScript(x=flatten(cull_index_8))  # -> out, A; inputs x: String; same code as c_script
construct_domain_2 = ConstructDomain(DomainStart=Slider(0, range=0..1), DomainEnd=Slider(0.5, range=0..1000))
bounds_2 = Bounds(Numbers=c_script_2.A)
construct_domain_3 = ConstructDomain(DomainStart=0, DomainEnd=Slider(255, range=0..1000))
remap_numbers_2 = RemapNumbers(Value=c_script_2.A, Source=bounds_2, Target=construct_domain_3)  # -> Mapped, Clipped
remap_numbers_3 = RemapNumbers(Value=c_script_2.A, Source=bounds_2, Target=construct_domain_2)  # -> Mapped, Clipped

# ---- group: Ice
list_item_9 = ListItem(List=read_excel_sheet_3.Rows, Index=Slider(2, range=0..100), Wrap=True)  # -> flatten(Item)
cull_index_9 = CullIndex(List=list_item_9, Indices=Slider(0, range=0..100), Wrap=True)
c_script_3 = CSharpScript(x=flatten(cull_index_9))  # -> out, A; inputs x: String; same code as c_script
bounds_3 = Bounds(Numbers=c_script_3.A)
construct_domain_4 = ConstructDomain(DomainStart=0, DomainEnd=Slider(255, range=0..1000))
remap_numbers_4 = RemapNumbers(Value=c_script_3.A, Source=bounds_3, Target=construct_domain_4)  # -> Mapped, Clipped

# ---- group: Wind / WindLatitude
list_item_10 = ListItem(List=read_excel_sheet_4.Rows, Index=Slider(0, range=0..100), Wrap=True)  # -> flatten(Item)
cull_index_10 = CullIndex(List=list_item_10, Indices=Slider(0, range=0..100), Wrap=True)
radians_7 = Radians(Degrees=cull_index_10)

# ---- group: Wind / WindLongitude
list_item_11 = ListItem(List=read_excel_sheet_4.Rows, Index=Slider(1, range=0..100), Wrap=True)  # -> flatten(Item)
cull_index_11 = CullIndex(List=list_item_11, Indices=Slider(0, range=0..100), Wrap=True)
radians_8 = Radians(Degrees=cull_index_11)

# ----
number_slider = Slider(0, range=0..100)

# ---- group: Wind
# There are 3 columns per WorkSheet,
# the xlsx file is created from a Python 2.7
# script that opens the grib2 file and saves
# the values stored according to their
# coordinates.
# We open our grib2 file with the ReadExcel component from TTToolbox
number_slider_2 = Slider(2, range=0..100)
list_item_12 = ListItem(List=read_excel_sheet_4.Rows, Index=number_slider_2, Wrap=True)  # -> flatten(Item)
cull_index_12 = CullIndex(List=list_item_12, Indices=Slider(0, range=0..100), Wrap=True)
c_script_4 = CSharpScript(x=flatten(cull_index_12))  # -> out, A; inputs x: String; same code as c_script
number_slider_3 = Slider(255, range=0..1000)
bounds_4 = Bounds(Numbers=c_script_4.A)
construct_domain_5 = ConstructDomain(DomainStart=0, DomainEnd=Slider(0.5, range=0..1000))
bounds_5 = Bounds(Numbers=c_script_4.A)
construct_domain_6 = ConstructDomain(DomainStart=number_slider, DomainEnd=number_slider_3)
bounds_6 = Bounds(Numbers=c_script_4.A)
construct_domain_7 = ConstructDomain(DomainStart=Slider(0, range=0..100), DomainEnd=Slider(1, range=0..1000))
remap_numbers_5 = RemapNumbers(Value=c_script_4.A, Source=bounds_4, Target=construct_domain_5)  # -> Mapped, Clipped
remap_numbers_6 = RemapNumbers(Value=c_script_4.A, Source=bounds_5, Target=construct_domain_6)  # -> Mapped, Clipped
remap_numbers_7 = RemapNumbers(Value=c_script_4.A, Source=bounds_6, Target=construct_domain_7)  # -> Mapped, Clipped

# ---- group: Wind / Projections
# We reproject our points into three
# different famous projections:
# WebMercator, Cassini and
# Spherical.
mercator = CSharpScript(lat=radians_7, lon=radians_8)  # -> out, A; inputs lat: Double, lon: Double
# ---------- mercator: C# ----------
    A = MercatorProjection(lat, lon);
# ---------- mercator: C# additional code ----------
  public Point3d MercatorProjection(double lat, double lon)
  {

    var earthRadius = 6367;

    double FSin = Math.Sin(lon);

    var x = lat * earthRadius;
    var y = ( earthRadius * 0.5 ) * Math.Log(( 1.0 + FSin ) / ( 1.0 - FSin ));

    return new Point3d(x, y, 0);

  }
# ---------- end mercator ----------
number_slider_4 = Slider(0.001, range=0..1)
multiplication = Multiplication(A=mercator.A, B=number_slider_4)

# ---- group: Temperature / Projections
mercator_2 = CSharpScript(lat=radians, lon=radians_2)  # -> out, A; inputs lat: Double, lon: Double; disabled; same code as mercator
number_slider_5 = Slider(0.001, range=0..1)
multiplication_2 = Multiplication(A=mercator_2.A, B=number_slider_4)  # disabled

# ---- group: Temperature / Projections / Cassini
cassini = CSharpScript(lat=radians, lon=radians_2)  # -> out, A; inputs lat: Double, lon: Double
# ---------- cassini: C# ----------
    A = CassiniProjection(lat, lon);
# ---------- cassini: C# additional code ----------
  public Point3d CassiniProjection(double lat, double lon)
  {

    var earthRadius = 6367;

    var x = earthRadius * Math.Asin(Math.Cos(lat) * Math.Sin(lon));
    var y = earthRadius * Math.Atan2(Math.Sin(lat), Math.Cos(lat) * Math.Cos(lon));
    var z = earthRadius * Math.Sin(lat);
    return new Point3d(x, y, 0);

  }
# ---------- end cassini ----------
multiplication_3 = Multiplication(A=cassini.A, B=number_slider_5)

# ---- group: Temperature / Projections / Spherical
spherical = CSharpScript(x=radians_2, y=radians)  # -> out, A; inputs x: Double, y: Double
# ---------- spherical: C# ----------
    A = convertSphericalToCartesian(x, y);
# ---------- spherical: C# additional code ----------
  public Point3d convertSphericalToCartesian(double lat, double lon)
  {

    var earthRadius = 6367;

    var x = earthRadius * Math.Cos(lat) * Math.Cos(lon);
    var y = earthRadius * Math.Cos(lat) * Math.Sin(lon);
    var z = earthRadius * Math.Sin(lat);
    return new Point3d(x, y, z);

  }
# ---------- end spherical ----------
multiplication_4 = Multiplication(A=spherical.A, B=number_slider_5)

# ---- group: Precipitation / Projections
mercator_3 = CSharpScript(lat=radians_4, lon=radians_3)  # -> out, A; inputs lat: Double, lon: Double; same code as mercator
number_slider_6 = Slider(0.001, range=0..1)
multiplication_5 = Multiplication(A=mercator_3.A, B=number_slider_4)

# ---- group: Precipitation / Projections / Cassini
cassini_2 = CSharpScript(lat=radians_4, lon=radians_3)  # -> out, A; inputs lat: Double, lon: Double; same code as cassini
multiplication_6 = Multiplication(A=cassini_2.A, B=number_slider_6)

# ---- group: Precipitation / Projections / Spherical
spherical_2 = CSharpScript(x=radians_3, y=radians_4)  # -> out, A; inputs x: Double, y: Double; same code as spherical
multiplication_7 = Multiplication(A=spherical_2.A, B=number_slider_6)

# ---- group: Ice / Projections
mercator_4 = CSharpScript(lat=radians_5, lon=radians_6)  # -> out, A; inputs lat: Double, lon: Double; disabled; same code as mercator
number_slider_7 = Slider(0.001, range=0..1)
multiplication_8 = Multiplication(A=mercator_4.A, B=number_slider_4)  # disabled

# ---- group: Ice / Projections / Cassini
cassini_3 = CSharpScript(lat=radians_5, lon=radians_6)  # -> out, A; inputs lat: Double, lon: Double; same code as cassini
multiplication_9 = Multiplication(A=cassini_3.A, B=number_slider_7)

# ---- group: Ice / Projections / Spherical
spherical_3 = CSharpScript(x=radians_6, y=radians_5)  # -> out, A; inputs x: Double, y: Double; same code as spherical
multiplication_10 = Multiplication(A=spherical_3.A, B=number_slider_7)

# ---- group: Wind / Projections / Cassini
cassini_4 = CSharpScript(lat=radians_7, lon=radians_8)  # -> out, A; inputs lat: Double, lon: Double; same code as cassini
multiplication_11 = Multiplication(A=cassini_4.A, B=number_slider_4)

# ---- group: Wind / Projections / Spherical
spherical_4 = CSharpScript(x=radians_8, y=radians_7)  # -> out, A; inputs x: Double, y: Double; same code as spherical
multiplication_12 = Multiplication(A=spherical_4.A, B=number_slider_4)

# ---- group: Temperature / CheckIfNULL
null_item = NullItem(Item=multiplication_2)  # -> NullFlags, InvalidFlags, Description; disabled
dispatch = Dispatch(List=remap_numbers.Mapped, DispatchPattern=null_item.InvalidFlags)  # -> ListA, ListB; disabled
dispatch_2 = Dispatch(List=multiplication_2, DispatchPattern=null_item.InvalidFlags)  # -> ListA, ListB; disabled
number = Number(dispatch.ListB)  # disabled
point = Point(dispatch_2.ListB)  # disabled

# ---- group: Precipitation / Projections / CheckIfNULL
null_item_2 = NullItem(Item=multiplication_5)  # -> NullFlags, InvalidFlags, Description
dispatch_3 = Dispatch(List=remap_numbers_3.Mapped, DispatchPattern=null_item_2.InvalidFlags)  # -> ListA, ListB
dispatch_4 = Dispatch(List=multiplication_5, DispatchPattern=null_item_2.InvalidFlags)  # -> ListA, ListB
number_2 = Number(dispatch_3.ListB)
point_2 = Point(dispatch_4.ListB)

# ---- group: Ice / Projections / CheckIfNULL
null_item_3 = NullItem(Item=multiplication_8)  # -> NullFlags, InvalidFlags, Description; disabled
dispatch_5 = Dispatch(List=remap_numbers_4.Mapped, DispatchPattern=null_item_3.InvalidFlags)  # -> ListA, ListB; disabled
dispatch_6 = Dispatch(List=multiplication_8, DispatchPattern=null_item_3.InvalidFlags)  # -> ListA, ListB; disabled
number_3 = Number(dispatch_5.ListB)  # disabled
point_3 = Point(dispatch_6.ListB)  # disabled

# ---- group: WebMercator / CheckIfNULL
# For some unknown reason the
# WebMercator projection gives nulls for
# some coordinates, it might have to do
# with the undefined character of the
# natural logarithm function for values
# smaller than zero.
null_item_4 = NullItem(Item=multiplication)  # -> NullFlags, InvalidFlags, Description
dispatch_7 = Dispatch(List=remap_numbers_5.Mapped, DispatchPattern=null_item_4.InvalidFlags)  # -> ListA, ListB
dispatch_8 = Dispatch(List=multiplication, DispatchPattern=null_item_4.InvalidFlags)  # -> ListA, ListB
number_4 = Number(dispatch_7.ListB)
point_4 = Point(dispatch_8.ListB)

# ---- group: BoxesAndDisplacement
construct_point = ConstructPoint(XCoordinate=0, YCoordinate=0, ZCoordinate=0)  # disabled
vector_2pt = Vector2Pt(PointA=construct_point, PointB=multiplication_12, Unitize=False)  # -> Vector, Length; disabled
amplitude = Amplitude(Vector=vector_2pt.Vector, Amplitude=remap_numbers.Mapped)  # disabled
number_5 = Number(remap_numbers_5.Mapped)  # disabled
vector_display = VectorDisplay(Anchor=construct_point, Vector=amplitude)  # disabled
move = Move(Geometry=multiplication_12, Motion=amplitude)  # -> Geometry, Transform; disabled
center_box = CenterBox(Base=move.Geometry, X=number_5, Y=number_5, Z=number_5)  # disabled

# ---- group: Temperature / CullLowerAndUpperLongitudes
number_slider_8 = Slider(17.77, range=0..100)  # disabled
deconstruct = Deconstruct(Point=point)  # -> XComponent, YComponent, ZComponent; disabled
setlongitudeupperlowerbounds = CSharpScript(x=deconstruct.YComponent, y=number_slider_8)  # -> A; inputs x: Double, y: Double; disabled
# ---------- setlongitudeupperlowerbounds: C# ----------
    bool test = false;
    double max = -y;
    if( x < y && x > max )
    {

      test = true;

    }

    A = test;
# ---------- end setlongitudeupperlowerbounds ----------
cull_pattern = CullPattern(List=point, CullPattern=setlongitudeupperlowerbounds)  # disabled
cull_pattern_2 = CullPattern(List=number, CullPattern=setlongitudeupperlowerbounds)  # disabled

# ---- group: Precipitation / Projections / CullLowerAndUpperLongitudes
deconstruct_2 = Deconstruct(Point=point_2)  # -> XComponent, YComponent, ZComponent
setlongitudeupperlowerbounds_2 = CSharpScript(x=deconstruct_2.YComponent, y=Slider(17.77, range=0..100))  # -> A; inputs x: Double, y: Double; same code as setlongitudeupperlowerbounds
cull_pattern_3 = CullPattern(List=point_2, CullPattern=setlongitudeupperlowerbounds_2)
cull_pattern_4 = CullPattern(List=number_2, CullPattern=setlongitudeupperlowerbounds_2)

# ---- group: Ice / Projections / CullLowerAndUpperLongitudes
number_slider_9 = Slider(17.77, range=0..100)  # disabled
deconstruct_3 = Deconstruct(Point=point_3)  # -> XComponent, YComponent, ZComponent; disabled
setlongitudeupperlowerbounds_3 = CSharpScript(x=deconstruct_3.YComponent, y=number_slider_9)  # -> A; inputs x: Double, y: Double; disabled; same code as setlongitudeupperlowerbounds
cull_pattern_5 = CullPattern(List=point_3, CullPattern=setlongitudeupperlowerbounds_3)  # disabled
cull_pattern_6 = CullPattern(List=number_3, CullPattern=setlongitudeupperlowerbounds_3)  # disabled

# ---- group: WebMercator / CullLowerAndUpperLongitudes
# The Mercator projection gives good
# results for values bigger than
# -85 degrees and smaller than
# 85 degrees of longitude. Latitude on the
# other hand is not a problem.
number_slider_10 = Slider(17.77, range=0..100)
deconstruct_4 = Deconstruct(Point=point_4)  # -> XComponent, YComponent, ZComponent
setlongitudeupperlowerbounds_4 = CSharpScript(x=deconstruct_4.YComponent, y=number_slider_10)  # -> A; inputs x: Double, y: Double; same code as setlongitudeupperlowerbounds
cull_pattern_7 = CullPattern(List=point_4, CullPattern=setlongitudeupperlowerbounds_4)
cull_pattern_8 = CullPattern(List=number_4, CullPattern=setlongitudeupperlowerbounds_4)

# ---- group: PointCloudViz
bounds_7 = Bounds(Numbers=cull_pattern_8)
construct_domain_8 = ConstructDomain(DomainStart=Slider(0, range=0..100), DomainEnd=Slider(255, range=0..1000))
remap_numbers_8 = RemapNumbers(Value=cull_pattern_8, Source=bounds_7, Target=construct_domain_8)  # -> Mapped, Clipped
gradient = Gradient(
    LowerLimit=number_slider_3,
    UpperLimit=number_slider,
    Parameter=remap_numbers_8.Mapped,
    stops=[0: RGB(0, 128, 0), 0.5: RGB(255, 255, 0), 1: RGB(255, 0, 0)])
colour_rgb = ColourRGB(Alpha=255, Red=expr("x*10", remap_numbers.Clipped), Green=0, Blue=0)
colour_rgb_2 = ColourRGB(Alpha=255, Red=0, Green=remap_numbers_2.Mapped, Blue=remap_numbers_2.Mapped)
colour_rgb_3 = ColourRGB(Alpha=255, Red=remap_numbers_4.Mapped, Green=remap_numbers_4.Mapped, Blue=remap_numbers_4.Mapped)
construct_point_cloud = ConstructPointCloud(Points=multiplication_4, Colours=colour_rgb)
construct_point_cloud_2 = ConstructPointCloud(Points=multiplication_7, Colours=colour_rgb_2)
construct_point_cloud_3 = ConstructPointCloud(Points=multiplication_10, Colours=colour_rgb_3)
construct_point_cloud_4 = ConstructPointCloud(Points=cull_pattern_7, Colours=gradient)
preview_point_cloud = PreviewPointCloud(PointCloud=construct_point_cloud, Weight=Slider(13, range=0..20))
preview_point_cloud_2 = PreviewPointCloud(PointCloud=construct_point_cloud_2, Weight=Slider(10, range=0..10))
preview_point_cloud_3 = PreviewPointCloud(PointCloud=construct_point_cloud_3, Weight=Slider(3, range=0..10))
preview_point_cloud_4 = PreviewPointCloud(PointCloud=construct_point_cloud_4, Weight=Slider(3, range=0..10))

# ---- group: Wind / SphericalPushPoints
# We can do a similar process with our
# Spherical Projection.
construct_point_2 = ConstructPoint(XCoordinate=0, YCoordinate=0, ZCoordinate=0)
point_5 = Point(multiplication_12)
list_item_13 = ListItem(List=point_5, Index=0, Wrap=True)
vector_2pt_2 = Vector2Pt(PointA=construct_point_2, PointB=list_item_13, Unitize=False)  # -> Vector, Length
number_6 = Number(remap_numbers_7.Mapped)
vector_2pt_3 = Vector2Pt(PointA=construct_point_2, PointB=point_5, Unitize=False)  # -> Vector, Length
addition = Addition(A=number_6, B=vector_2pt_2.Length)
amplitude_2 = Amplitude(Vector=vector_2pt_3.Vector, Amplitude=addition)
gradient_2 = Gradient(
    LowerLimit=number_slider_3,
    UpperLimit=number_slider,
    Parameter=remap_numbers_6.Mapped,
    stops=[0: RGB(234, 38, 0), 0.25: RGB(234, 126, 0), 0.5: RGB(254, 244, 84), 0.75: RGB(173, 203, 249), 1: RGB(75, 107, 169)])
move_2 = Move(Geometry=construct_point_2, Motion=amplitude_2)  # -> Geometry, Transform
construct_point_cloud_5 = ConstructPointCloud(Points=move_2.Geometry, Colours=gradient_2)
preview_point_cloud_5 = PreviewPointCloud(PointCloud=construct_point_cloud_5, Weight=Slider(10, range=0..10))

# ---- group: Wind / HeightMap
# Now that we have our geographical
# coordinates projected to the cartesian
# plane, we want to emphasize the data
# that each place contains, therefore we
# translate our points in the z vector to get
# what is called in computer graphics
# Heightmap.
unit_z = UnitZ(Factor=cull_pattern_8)
move_3 = Move(Geometry=cull_pattern_7, Motion=unit_z)  # -> Geometry, Transform
delaunay_mesh = DelaunayMesh(Points=move_3.Geometry, Plane=PlaneXY(0, 0, 0))
mesh_colours = MeshColours(Mesh=delaunay_mesh, Colours=gradient)
weaverbird_s_loop_subdivision = WeaverbirdsLoopSubdivision(MeshCurves=mesh_colours, Level=1, SmoothNakedEdges=1)
weaverbird_s_midedge_subdivision = WeaverbirdsMidedgeSubdivision(MeshCurves=mesh_colours, Level=1, SmoothNakedEdges=1)  # disabled
weaverbird_s_catmull_clark_subdivision = WeaverbirdsCatmullClarkSubdivision(MeshCurves=mesh_colours, Level=1, SmoothNakedEdges=1)  # disabled

# ---- group: AttractorsEmphasizeDataPeaks
# In the same fashion, we want to get some
# sort of cross-relationship between data.
# So we move our points according to the
# top rainy places in the world. We do so
# by picking the peak of the rain data and
# assigning those points to a Spin-Force
# component from the class of
# Vector-Fields.
unit_z_2 = UnitZ(Factor=cull_pattern_4)
move_4 = Move(Geometry=cull_pattern_3, Motion=unit_z_2)  # -> Geometry, Transform
expression = Expression(x=cull_pattern_4, y=Slider(0.35, range=0..1), Expression="If( x > y, True, False )")
expression_2 = Expression(x=cull_pattern_8, y=Slider(0.4, range=0..1), Expression="If( x > y, True, False )")
cull_pattern_9 = CullPattern(List=move_4.Geometry, CullPattern=expression)
cull_pattern_10 = CullPattern(List=cull_pattern_4, CullPattern=expression)
cull_pattern_11 = CullPattern(List=move_3.Geometry, CullPattern=expression_2)
number_slider_11 = Slider(2, range=0..2)
remove_duplicate_points = RemoveDuplicatePoints(InputPoints=cull_pattern_9, Tolerance=Slider(2, range=0..10))  # -> OutputPoints, FirstPointIndexes
null_item_5 = NullItem(Item=remove_duplicate_points.OutputPoints)  # -> NullFlags, InvalidFlags, Description
dispatch_9 = Dispatch(List=cull_pattern_9, DispatchPattern=null_item_5.InvalidFlags)  # -> ListA, ListB
point_6 = Point(dispatch_9.ListB)
dispatch_10 = Dispatch(List=cull_pattern_10, DispatchPattern=null_item_5.InvalidFlags)  # -> ListA, ListB
number_7 = Number(dispatch_10.ListB)
spin_force = SpinForce(Plane=point_6, Strength=number_7, Radius=number_7, Decay=number_slider_11)
point_charge = PointCharge(Point=point_6, Charge=number_7, Decay=number_slider_11)
merge_fields = MergeFields(Fields=spin_force)
number_slider_12 = Slider(0, range=0..100)
number_slider_13 = Slider(10, range=0..100)
evaluate_field = EvaluateField(Field=merge_fields, Point=cull_pattern_7)  # -> Tensor, Strength
vector_2pt_4 = Vector2Pt(PointA=move_3.Geometry, PointB=cull_pattern_11, Unitize=False)  # -> Vector, Length
bounds_8 = Bounds(Numbers=evaluate_field.Strength)
construct_domain_9 = ConstructDomain(DomainStart=number_slider_12, DomainEnd=number_slider_13)
remap_numbers_9 = RemapNumbers(Value=evaluate_field.Strength, Source=bounds_8, Target=construct_domain_9)  # -> Mapped, Clipped
amplitude_3 = Amplitude(Vector=vector_2pt_4.Vector, Amplitude=remap_numbers_9.Mapped)
move_5 = Move(Geometry=move_3.Geometry, Motion=amplitude_3)  # -> Geometry, Transform
gradient_3 = Gradient(
    LowerLimit=number_slider_12,
    UpperLimit=number_slider_13,
    Parameter=remap_numbers_9.Mapped,
    stops=[0: RGB(234, 38, 0), 0.25: RGB(234, 126, 0), 0.5: RGB(254, 244, 84), 0.75: RGB(173, 203, 249), 1: RGB(75, 107, 169)])
delaunay_mesh_2 = DelaunayMesh(Points=move_5.Geometry, Plane=PlaneXY(0, 0, 0))
mesh_colours_2 = MeshColours(Mesh=delaunay_mesh_2, Colours=gradient_3)
