# Grasshopper definition Workshop.gh (Grasshopper 0.9.76)
# plug-ins: TT Toolbox

read_excel_sheet = ReadExcelSheet(Run=Toggle(True), Worksheet="Sheet1", Listen=False)  # -> UserMessages, Columns, Rows
list_item = ListItem(List=read_excel_sheet.Rows, Index=Slider(2, range=0..100), Wrap=True)  # -> flatten(Item)
list_item_2 = ListItem(List=read_excel_sheet.Rows, Index=Slider(3, range=0..100), Wrap=True)  # -> flatten(Item)
list_item_3 = ListItem(List=read_excel_sheet.Rows, Index=Slider(1, range=0..100), Wrap=True)  # -> flatten(Item)
list_item_4 = ListItem(List=read_excel_sheet.Rows, Index=Slider(0, range=0..100), Wrap=True)  # -> flatten(Item)
cull_index = CullIndex(List=list_item, Indices=Slider(0, range=0..100), Wrap=True)
cull_index_2 = CullIndex(List=list_item_2, Indices=Slider(0, range=0..100), Wrap=True)
cull_index_3 = CullIndex(List=list_item_3, Indices=Slider(0, range=0..100), Wrap=True)
cull_index_4 = CullIndex(List=list_item_4, Indices=Slider(0, range=0..100), Wrap=True)
panel = Panel(cull_index)
panel_2 = Panel(cull_index_2)
panel_3 = Panel(cull_index_3)
panel_4 = Panel(cull_index_4)
radians = Radians(Degrees=cull_index_4)
radians_2 = Radians(Degrees=cull_index_3)
cassini = CSharpScript(lat=radians, lon=radians_2)  # -> out, A; inputs lat: Double, lon: Double
# ---------- cassini: C# ----------
    A = CassiniProjection(lat, lon);
# ---------- cassini: C# additional code ----------
  public Point3d CassiniProjection(double lat, double lon)
  {

    var earthRadius = 6367;

    var x = earthRadius * Math.Asin(Math.Cos(lat) * Math.Sin(lon));
    var y = earthRadius * Math.Atan2(Math.Sin(lat), Math.Cos(lat) * Math.Cos(lon));
    var z = earthRadius * Math.Sin(lat);
    return new Point3d(x, y, 0);

  }
# ---------- end cassini ----------
spherical = CSharpScript(x=radians, y=radians_2)  # -> out, A; inputs x: Double, y: Double
# ---------- spherical: C# ----------
    A = convertSphericalToCartesian(x, y);
# ---------- spherical: C# additional code ----------
  public Point3d convertSphericalToCartesian(double lat, double lon)
  {

    var earthRadius = 6367;

    var x = earthRadius * Math.Cos(lat) * Math.Cos(lon);
    var y = earthRadius * Math.Cos(lat) * Math.Sin(lon);
    var z = earthRadius * Math.Sin(lat);
    return new Point3d(x, y, z);

  }
# ---------- end spherical ----------
number_slider = Slider(0.001, range=0..1)
c_script = CSharpScript(x=flatten(cull_index))  # -> out, A; inputs x: String
# ---------- c_script: C# ----------
    string ou = x;

    if( ou == "" ) ou = "1";

    double inte = System.Convert.ToDouble(ou);

    A = ou;
# ---------- end c_script ----------
c_script_2 = CSharpScript(x=flatten(cull_index_2))  # -> out, A; inputs x: String; same code as c_script
multiplication = Multiplication(A=cassini.A, B=number_slider)
multiplication_2 = Multiplication(A=spherical.A, B=number_slider)
number = Number(c_script.A)
number_2 = Number(c_script_2.A)
multiplication_3 = Multiplication(A=number, B=0.01)
multiplication_4 = Multiplication(A=number_2, B=Slider(1000, range=0..1000))
colour_rgb = ColourRGB(Alpha=255, Red=multiplication_3, Green=multiplication_4, Blue=multiplication_4)
number_slider_2 = Slider(0.01, range=0..0.01)
dot_display = DotDisplay(Point=multiplication, Colour=colour_rgb, Size=Slider(0.05, range=0..1))
